# Grasshopper definition Project2GrasshopperSim.gh (Grasshopper 0.9.76)

# ---- group: grid
slider = Slider(18, range=0..25)
sqgrid = Square(Plane=PlaneXY(0, 0, 0), Size=1, ExtentX=slider, ExtentY=slider)  # -> Cells, flatten(Points)

# ----
pt = Point(sqgrid.Points)
lng = ListLength(List=pt)
panel = Panel(lng)
cir = Circle(Plane=pt, Radius=Slider(0, range=0..1))
random = Random(Range=Domain(0, 1), Number=panel, Seed=Slider(0.439, range=0..5))  # disabled
scale = Scale(Geometry=cir, Center=pt, Factor=0.5)  # -> Geometry, Transform

# ----
# Red Yucca
swatch = ColourSwatch(SwatchColor=RGB(125, 143, 77))
panel_2 = Panel([swatch, ColourSwatch(SwatchColor=RGB(194, 78, 118)), ColourSwatch(SwatchColor=RGB(125, 143, 77))])
item = ListItem(List=panel_2, Index=0, Wrap=True)

# ----
# Little Bluestem
swatch_2 = ColourSwatch(SwatchColor=RGB(194, 2, 34))
panel_3 = Panel([ColourSwatch(SwatchColor=RGB(144, 165, 166)), swatch_2, ColourSwatch(SwatchColor=RGB(135, 88, 68))])
item_2 = ListItem(List=panel_3, Index=0, Wrap=True)

# ----
# Bear Grass
swatch_3 = ColourSwatch(SwatchColor=RGB(144, 163, 65))
panel_4 = Panel([swatch_3, ColourSwatch(SwatchColor=RGB(187, 191, 168)), ColourSwatch(SwatchColor=RGB(144, 163, 65))])
item_3 = ListItem(List=panel_4, Index=0, Wrap=True)

boundary = BoundarySurfaces(Edges=scale.Geometry)
preview = CustomPreview(
    Geometry=boundary,
    Shader={ambient=RGB(0, 0, 0), diffuse=RGB(255, 105, 180), emission=RGB(76, 32, 54), shine=0.5, specular=RGB(255, 255, 255), transparency=0})
